# Grasshopper definition Morphing_with_Interpolation_on_Multiple_Curves.ghx (Grasshopper 0.9.76)
# plug-ins: Python Interpreter

# ---- group: ClosedSet
crv = Curve(reparameterize(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))
crv_2 = Curve(reparameterize(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))
crv_3 = Curve(reparameterize(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))
crv_4 = Curve(reparameterize(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))
crv_5 = Curve(reparameterize(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))
crv_6 = Curve(reparameterize(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))
crv_7 = Curve(reparameterize(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))
crv_8 = Curve(reparameterize(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))
merge = Merge(Data1=crv_5, Data2=crv_6, Data3=crv, Data4=crv_7, Data5=crv_2, Data6=crv_3, Data7=crv_4, Data8=crv_8)  # -> flatten(Result)

crv_9 = Curve(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)
crv_10 = Curve(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)
crv_11 = Curve(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)
crv_12 = Curve(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)
crv_13 = Curve(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)
crv_14 = Curve(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)
crv_15 = Curve(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)
crv_16 = Curve(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)
merge_2 = Merge(Data1=crv_9, Data2=crv_13, Data3=crv_10, Data4=crv_14, Data5=crv_15, Data6=crv_11, Data7=crv_16, Data8=crv_12)

# ----
viewer = ParamViewer(merge)
crv_17 = Curve(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)
pt = Point([Point(-4.260286896, -0.08682220482, 0), Point(2.261572102, 1.672124225, 0), Point(5.988820172, -1.431872796, 0), Point(8.868538617, -2.322862697, 0)])

# ---- group: old ver
python = PythonScript(crvs=merge_2, divCount=Slider(39, range=0..250), SeqCount=Slider(15, range=0..100))  # -> out, crvs_w_sequence, calcDomain, lastFrame, debug; inputs crvs: list of Curve
# ---------- python: Python ----------
import rhinoscriptsyntax as rs
import Rhino.Geometry as rg
import ghpythonlib.components as ghpc



divCrvPts = []
seqCrv = []
render_Pts = []
RENDER = []



### 3 Curve(List Access)



### 30 Point (3 x 10)
for i in xrange(len(crvs)):
    pts = rs.DivideCurve(crvs[i], divCount)
    
    for j in xrange(divCount):
        tmp_pt = pts[j]
        divCrvPts.append(tmp_pt)
#print(len(divCrvPts))



### Flipping Matrix, ((0,10,20), (1,11,21), ...)
for i in xrange(divCount):
    flipMatPts = []
    flipMat_Line_Z = []
    
    for j in xrange(len(crvs)):
        # print(int(j*divCount + i))
        tmp_mat = divCrvPts[int(j*divCount + i)]
        tmp_mat_Add_Z_src = rs.AddPoint((tmp_mat.X, tmp_mat.Y, tmp_mat.Z))
        tmp_mat_Add_Z = rs.coerce3dpoint(tmp_mat_Add_Z_src)
        tmp_mat_Add_Z.Z = 1.0
        
        tmp_Line = rs.AddLine(tmp_mat, tmp_mat_Add_Z)
        flipMatPts.append(tmp_mat)
        flipMat_Line_Z.append(tmp_Line)
    
    #print(len(flipMatPts))
    #print(len(flipMat_Line_Z))
    #print("- - -")
    
    tmp_interpCrv = rs.AddInterpCurve(flipMatPts)
    tmp_interpCrv_coerce = rs.coercecurve(tmp_interpCrv)
    tmp_interpCrv_coerce.Domain = rg.Interval(0,1)
    
    all_v2 = []
    Result_v2 = []
    
    for k in xrange(len(flipMat_Line_Z)):
        flipMat_Line_Z_coerce = rs.coercecurve(flipMat_Line_Z[k])
        v1, v2 ,v3 = ghpc.CurveXCurve(tmp_interpCrv_coerce, flipMat_Line_Z_coerce)
        #print("v2", v2)
        all_v2.append(v2)
    
    debug = all_v2
    
    tmp_Result = 0
    
    for l in xrange(len(all_v2)):
        tmp_List = all_v2[l]
        if type(tmp_List) is list:
#            print(tmp_List)
#            print(tmp_Result)
            Result_v2.append(tmp_List[tmp_Result])
            tmp_Result+=1
        else:
            Result_v2.append(tmp_List)
    
    #print(Result_v2)
    #print(len(Result_v2))
#    print(type(Result_v2))
#    print(tmp_interpCrv_coerce)

    
    shatterCrv = ghpc.Shatter(tmp_interpCrv_coerce, Result_v2)
    #print(len(shtterCrv))
    #print(type(shtterCrv))
    
    
    Final_Pts = []
    for m in xrange(len(shatterCrv)):
        tmp_Final_Pts = rs.DivideCurve(shatterCrv[m], SeqCount)
        #pritn(len(tmp_Final_Pts))
        
        for n in xrange(len(tmp_Final_Pts)):
            Final_Pts.append(tmp_Final_Pts[n])
        
    #print(Final_Pts)
    #print(len(Final_Pts))
    
    for o in xrange(len(Final_Pts)):
        render_Pts.append(Final_Pts[o])



#print(len(render_Pts))
#print(len(Final_Pts))
#print(len(crvs))

### Render
for i in xrange(len(Final_Pts)):
    Render_Curve_Pts = []
    for j in xrange(divCount):
        #print(int(j*len(Final_Pts) + i))
        tmp_render_pt = render_Pts[int(j*len(Final_Pts) + i)]
        Render_Curve_Pts.append(tmp_render_pt)
    #print(len(Render_Curve_Pts))
    #RENDER_CRV = rs.AddInterpCurve(Render_Curve_Pts)
    RENDER_CRV, tmp_999, tmp_998 = ghpc.Interpolate(Render_Curve_Pts, 3, True)
    RENDER.append(RENDER_CRV)


crvs_w_sequence = RENDER
calcDomain = rg.Interval(0,len(RENDER)-1)
lastFrame = len(RENDER)-1
# ---------- end python ----------

# ----
python_2 = PythonScript(CURVES=merge, DIV_COUNT=Slider(158, range=0..250), SEQ_COUNT=Slider(15, range=0..100))  # -> CRUVES_w_SEQ, DOMAIN, LAST_FRAME, DEBUG; inputs CURVES: list of Curve
# ---------- python_2: Python ----------
import rhinoscriptsyntax as rs
import Rhino.Geometry as rg



### Divide Curve
def divide_crvs(crvs, div_count):
    points_div = []
    
    for i in xrange(len(crvs)):
        tmp_pts = rs.DivideCurve(crvs[i], div_count)
        points_div.append(tmp_pts)
    
    # print points_div
    # print len(points_div)
    # print len(points_div[0])
    
    ### 2D Array
    return points_div



### Flip 2D Array
def flip_2d_array(array_2d):
    
    array_2d_f = list(map(list, zip(*array_2d)))
    # print len(array_2d_f)
    # print len(array_2d_f[0])
    
    return array_2d_f



### InterpCrv
def interp_crvs(array_2d_f):
    in_crvs = []
    
    for i in xrange(len(array_2d_f)):
        crv = rs.AddInterpCurve(array_2d_f[i])
        in_crvs.append(crv)
    
    return in_crvs



### Slice Sequence
def slice_sequence(crvs, seq_count):
    
    pt_slice = []
    
    frame = 1 / seq_count
    # print frame
    
    
    for i in xrange(len(crvs)):
        crv = crvs[i]
        crv = rs.coercecurve(crv)
        start_pt, end_pt = rs.CurveDomain(crv)
        # print start_pt, "to", end_pt ### [0 to len(Curves)]
        
        param_slice = []
        for j in xrange(int(end_pt)):
            
            for k in xrange(seq_count):
                value = j + k*frame
                param_slice.append(value)
        
        param_slice.append(end_pt)
        
        # print param_slice
        # print len(param_slice)
        
        sub_list = []
        for l in xrange(len(param_slice)):
            pt = rg.Curve.PointAt(crv, param_slice[l])
            sub_list.append(pt)
        
        pt_slice.append(sub_list)
    
    return pt_slice



### Generate Frame
def generate_frame(pt_array):
    
    crv_frame = []
    for i in xrange(len(pt_array)):
        
        pt_list = []
        tmp_list = pt_array[i]
        
        ### closed, add -1
        for j in xrange(len(tmp_list)):
            pt_list.append(tmp_list[j])
        
        pt_list.append(tmp_list[0])
        
        crv = rs.AddInterpCurve(pt_list)
        rs.CloseCurve(crv)
        crv_frame.append(crv)
    
    return crv_frame






pts_div_crv = divide_crvs(CURVES, DIV_COUNT)
pts_div_crv_flip = flip_2d_array(pts_div_crv)

crvs_interpolate = interp_crvs(pts_div_crv_flip)

pt_slice = slice_sequence(crvs_interpolate, SEQ_COUNT)
pt_slice_flip = flip_2d_array(pt_slice)

crvs_all_frame = generate_frame(pt_slice_flip)



### Output
CRUVES_w_SEQ = crvs_all_frame
DOMAIN = rg.Interval(0, len(crvs_all_frame)- 1)
LAST_FRAME = len(crvs_all_frame)
# ---------- end python_2 ----------
python_3 = PythonScript(x=crv_17, y=pt)  # -> out, a; inputs y: list
# ---------- python_3: Python ----------
import rhinoscriptsyntax as rs


split_pts = []

for i in xrange(len(y)):
    val = rs.CurveClosestPoint(x, y[i])
    # print i, val
    split_pts.append(val)

print split_pts
"""
[2.7106788203191816, 18.974186968716765, 26.608508703367868, 32.523070288997054]
"""


a = rs.SplitCurve(x, split_pts)
# ---------- end python_3 ----------
viewer_2 = ParamViewer(python_2.CRUVES_w_SEQ)
panel = Panel(python_2.DEBUG)
panel_2 = Panel(python_3.a)
crv_18 = Curve(python_2.CRUVES_w_SEQ)
panel_3 = Panel(python_2.DOMAIN)
remap = RemapNumbers(Value=Slider(0.86, range=0..1), Source="0 to 1", Target=panel_3)  # -> Mapped, Clipped
item = ListItem(List=crv_18, Index=remap.Mapped, Wrap=True)
Z = UnitZ(Factor=1)
move = Move(Geometry=item, Motion=Z)  # -> Geometry, Transform
colour = ColourPicker(PickedColour=RGB(255, 255, 255))
colour_2 = ColourPicker(PickedColour=RGB(0, 0, 0))
brep = Brep(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)
preview = CustomPreview(Geometry=brep, Shader=colour)
preview_2 = CustomPreview(Geometry=move.Geometry, Shader=colour_2)
