# Grasshopper definition Morphing_with_Interpolation_on_Multiple_Curves_Animation.ghx (Grasshopper 0.9.76)
# plug-ins: Python Interpreter

# ---- group: ClosedSet
crv = Curve(reparameterize(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))
crv_2 = Curve(reparameterize(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))
crv_3 = Curve(reparameterize(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))
crv_4 = Curve(reparameterize(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))
crv_5 = Curve(reparameterize(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))
crv_6 = Curve(reparameterize(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))
crv_7 = Curve(reparameterize(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))
crv_8 = Curve(reparameterize(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))
merge = Merge(Data1=crv_7, Data2=crv_8, Data3=crv, Data4=crv_2, Data5=crv_3, Data6=crv_4, Data7=crv_5, Data8=crv_6)  # -> flatten(Result)

# ----
viewer = ParamViewer(merge)
python = PythonScript(CURVES=merge, DIV_COUNT=Slider(158, range=0..250), SEQ_COUNT=Slider(15, range=0..100))  # -> CRUVES_w_SEQ, DOMAIN, LAST_FRAME, DEBUG; inputs CURVES: list of Curve
# ---------- python: Python ----------
import rhinoscriptsyntax as rs
import Rhino.Geometry as rg



### Divide Curve
def divide_crvs(crvs, div_count):
    points_div = []
    
    for i in xrange(len(crvs)):
        tmp_pts = rs.DivideCurve(crvs[i], div_count)
        points_div.append(tmp_pts)
    
    # print points_div
    # print len(points_div)
    # print len(points_div[0])
    
    ### 2D Array
    return points_div



### Flip 2D Array
def flip_2d_array(array_2d):
    
    array_2d_f = list(map(list, zip(*array_2d)))
    # print len(array_2d_f)
    # print len(array_2d_f[0])
    
    return array_2d_f



### InterpCrv
def interp_crvs(array_2d_f):
    in_crvs = []
    
    for i in xrange(len(array_2d_f)):
        crv = rs.AddInterpCurve(array_2d_f[i])
        in_crvs.append(crv)
    
    return in_crvs



### Slice Sequence
def slice_sequence(crvs, seq_count):
    
    pt_slice = []
    
    frame = 1 / seq_count
    # print frame
    
    
    for i in xrange(len(crvs)):
        crv = crvs[i]
        crv = rs.coercecurve(crv)
        start_pt, end_pt = rs.CurveDomain(crv)
        # print start_pt, "to", end_pt ### [0 to len(Curves)]
        
        param_slice = []
        for j in xrange(int(end_pt)):
            
            for k in xrange(seq_count):
                value = j + k*frame
                param_slice.append(value)
        
        param_slice.append(end_pt)
        
        # print param_slice
        # print len(param_slice)
        
        sub_list = []
        for l in xrange(len(param_slice)):
            pt = rg.Curve.PointAt(crv, param_slice[l])
            sub_list.append(pt)
        
        pt_slice.append(sub_list)
    
    return pt_slice



### Generate Frame
def generate_frame(pt_array):
    
    crv_frame = []
    for i in xrange(len(pt_array)):
        
        pt_list = []
        tmp_list = pt_array[i]
        
        ### closed, add -1
        for j in xrange(len(tmp_list)):
            pt_list.append(tmp_list[j])
        
        pt_list.append(tmp_list[0])
        
        crv = rs.AddInterpCurve(pt_list)
        rs.CloseCurve(crv)
        crv_frame.append(crv)
    
    return crv_frame






pts_div_crv = divide_crvs(CURVES, DIV_COUNT)
pts_div_crv_flip = flip_2d_array(pts_div_crv)

crvs_interpolate = interp_crvs(pts_div_crv_flip)

pt_slice = slice_sequence(crvs_interpolate, SEQ_COUNT)
pt_slice_flip = flip_2d_array(pt_slice)

crvs_all_frame = generate_frame(pt_slice_flip)



### Output
CRUVES_w_SEQ = crvs_all_frame
DOMAIN = rg.Interval(0, len(crvs_all_frame)- 1)
LAST_FRAME = len(crvs_all_frame)
# ---------- end python ----------
viewer_2 = ParamViewer(python.CRUVES_w_SEQ)
panel = Panel("C:\Users\yoshioca\Documents\Morphing_with_Interpolation_on_Multiple_Curves\Export_Sequence\")
panel_2 = Panel(python.LAST_FRAME)
crv_9 = Curve(python.CRUVES_w_SEQ)
crv_10 = Curve(python.CRUVES_w_SEQ)
panel_3 = Panel(python.DOMAIN)
viewer_3 = ParamViewer(python.CRUVES_w_SEQ)
python_2 = PythonScript(count=panel_2, crvs=crv_9, path=panel, type=".png", toggle=Toggle(False))  # -> out, a; inputs count: Int32, crvs: list of Curve
# ---------- python_2: Python ----------
import Rhino
import rhinoscriptsyntax as rs
import scriptcontext as sc
import ghpythonlib.components as ghpc


sc.doc = ghdoc

if toggle:
    
    sc.doc = Rhino.RhinoDoc.ActiveDoc
    
    for i in xrange(count):
        
        curve = ghpc.ListItem(crvs, i)
#        print(curve)
        sc.doc.Objects.AddCurve(curve)
        
        name_format = "%03d"%i
        export_name = path + str(name_format) + type
        
        
        query = "-ViewCaptureToFile "+ \
            export_name + \
           " W=1080 H=1080 S=1 D=_No R=_No A=_No T=_Yes " + \
           " _Enter " + \
           " _SelAll _Delete"
        
        
        rs.Command(query)
    
        #print(query)
# ---------- end python_2 ----------
remap = RemapNumbers(Value=Slider(1, range=0..1), Source="0 to 1", Target=panel_3)  # -> Mapped, Clipped
panel_4 = Panel(python_2.a)
item = ListItem(List=crv_10, Index=remap.Mapped, Wrap=True)
Z = UnitZ(Factor=1)
move = Move(Geometry=item, Motion=Z)  # -> Geometry, Transform
colour = ColourPicker(PickedColour=RGB(255, 255, 255))
colour_2 = ColourPicker(PickedColour=RGB(0, 0, 0))
brep = Brep(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)
preview = CustomPreview(Geometry=brep, Shader=colour)
preview_2 = CustomPreview(Geometry=move.Geometry, Shader=colour_2)
